# Grasshopper definition TestFile.gh (Grasshopper 1.0.4)
# plug-ins: CurvedCreaseFolding

rectangle = Rectangle(Plane=PlaneXY(0, 0, 0), XSize="0 to 10", YSize="0 to 10", Radius=0)  # -> Rectangle, Length
number_slider = Slider(10, range=0..10)
mplane = MeshPlane(Boundary=rectangle.Rectangle, WidthCount=number_slider, HeightCount=number_slider)  # -> Mesh, Area
medges = MeshEdges(Mesh=mplane.Mesh)  # -> NakedEdges, InteriorEdges, NonManifoldEdges
mesh = Mesh(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)
dispatch = Dispatch(List=medges.InteriorEdges, DispatchPattern=[True, False])  # -> simplify(flatten(ListA)), ListB
crv_1 = Curve(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)
crv_2 = Curve(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)
geo = Geometry(dispatch.ListA)
crvcrsfld = CurvedCreaseFolding(Mesh=mplane.Mesh, Degree=Slider(1.2, range=0..2), FoldCurves=crv_1)  # -> Mesh, EdgeLines
join = JoinCurves(Curves=crvcrsfld.EdgeLines, Preserve=False)

# ---- group: output
mesh_2 = Mesh(crvcrsfld.Mesh)

# ----
material = CreateMaterial(
    Diffuse=ColourSwatch(SwatchColor=RGB(0, 255, 234)),
    Specular=RGB(255, 255, 255),
    Emission=ColourSwatch(SwatchColor=RGB(0, 84, 77)),
    Transparency=Slider(0.3, range=0..1),
    Shine=Slider(61, range=0..100))
pipe = Pipe(Curve=join, Radius=Slider(0.05, range=0..0.1), Caps=0)
mesh_without_flattenability_with_1_6_rad = Mesh(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)  # "Mesh without flattenability with 1.6 Radians"
mesh_without_flattenability_with_1_2_rad = Mesh(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)  # "Mesh without flattenability with 1.2 Radians"
preview = CustomPreview(Geometry=mesh_2, Material=material)
preview_2 = CustomPreview(Geometry=pipe, Material=ColourSwatch(SwatchColor=RGB(255, 0, 77)))
